# Requirement set NGOS (R2025a)
Need: Our vehicle is for abled body college students between 5'6” and 6’4” ft, with a max weight limit of 300 lbs.
The ideal geography is in mid-Atlantic urban areas, and it is used for commuting only 10 miles a day via this bike.
The vehicle will be used for small grocery runs, going to and from class, and going for brief leisure rides.
 It will withstand elements such as rain and snow and have a sporty aspect that is conducive to driving.
The vehicle will have sensing capabilities to relay the vehicle’s performance to the driver.

## 1 [Mid-Atlantic Weather/Geography Conditions]
The goal is to ride in the same conditions as a car in the DMV Area.

### 1.1 [Rain]

### 1.2 [Snow]

### 1.3 [Heat]

### 1.4 [Mud]

### 1.5 [Hills]

## 2 [Enhanced Driver Situational Awareness]

### 2.1 [Sensors]

#### 2.1.1 [Wattage]

#### 2.1.2 [Temperature]

#### 2.1.3 [Battery / Voltage level]

#### 2.1.4 [Speed]

#### 2.1.5 [Sensor Operation Validation]
The Idea here is to indicate whether or not a sensor is working "in condition" or in other words, providing accurate measurements. (TLDR: Working or faulty)

### 2.2 [Ergonomic Indicators]
The ability to see the system diagnostics at a glance

#### 2.2.1 [Speed]
T

#### 2.2.2 [Battery Level]

## 3 [Flexible anthropology of a person]

### 3.1 [Height Compensation]
5' - 6' 4"

#### 3.1.1 [Fit in seat]

##### 3.1.1.1 [Lower Lumbar Support]

#### 3.1.2 [Comfortable Handlebars]

#### 3.1.3 [Reaching pedals]

### 3.2 [Weight Compensation]
<275 lbs

#### 3.2.1 [Structure is Unable deform under 275 lbs load]

### 3.3 [Endurance / Strength Compensation]

#### 3.3.1 [Pedal Strength Compensation]
Force needed to do work on the pedals

#### 3.3.2 [Steering Compensation]

## 4 [Built for Urban Destinations]

### 4.1 [Travel to class]

#### 4.1.1 [Be able to secure the vehicle when not in operation]

#### 4.1.2 [Sleek Design]
We dont want to look

#### 4.1.3 [Comfortably move around people]
Ability to comfortably move around people

### 4.2 [Sport Driving Condititions]
Speeds reach 20+mph

#### 4.2.1 [Must reach a velocity of 30mph forward]

### 4.3 [Small Grocery Runs]

#### 4.3.1 [Cargo Compartment]

#### 4.3.2 [Secured Cargo]
Being able to

### 4.4 [Leisure Riding Conditions]

#### 4.4.1 [Minimal Effort for Actuaction]

## 5 [Safety]

### 5.1 [Rollover and Fall Protection]
RO: 90deg+ of falling tilt
Fall: Up to 90 deg of falling tilt

#### 5.1.1 [Driver immovability]
When is in a crash, we dont want them to move out of their seat or for their head to experience too much whiplash.

### 5.2 [Electrical Protection]

#### 5.2.1 [Component Preservation]
Some components may overheat or draw too much current. We need to mitigate that.

### 5.3 [Health Safety]

#### 5.3.1 [Preventing Cuts]

#### 5.3.2 [Legal Health Aspects]

##### 5.3.2.1 [Head Safety]

##### 5.3.2.2 [Leg Safety]

##### 5.3.2.3 [Arm Safety]

#### 5.3.3 [Driver Ingress and Egress]

### 5.4 [Road Safety]

#### 5.4.1 [Road Visibility]
To see and be seen